# Grasshopper definition simple_def.gh (Grasshopper 1.0.8)

pt = Point(Point(-5.557440742, 12.75798649, 0))
pt_2 = Point(Point(-3.3943921, -2.611043335, 0))
ln = Line(StartPoint=pt, EndPoint=pt_2)
collectme = Line(ln)
